# Grasshopper definition Dataset Generator.gh (Grasshopper 1.0.7)
# plug-ins: Human, EleFront

# ---- group: Pull boundary curves from Rhino doc
list = ValueList({"Point": 0, "Curve": 1, "Arc": 2, "Circle": 3, "Ellipse": 4, "Line": 5, "Polyline": 6, "Surface": 7, "Brep": 8, "Mesh": 9, "Polysurface": 10, "Block": 11, "Text": 12, "TextDot": 13, "Dimension": 14, "LinearDimension": 15, "AngularDimension": 16, "Hatch": 17, "Leader": 18}, selected="Curve")
reflay = ReferenceByLayer(LayerName="scaled boundaries")  # -> simplify(ScaledBoundaries)
filtertype = FilterByType(Geometry=reflay, ObjectType=list)
crv = Curve(filtertype)

# ----
panel = Panel("Image Output")

# ---- group: Pull organized curve objects from layers and draw color surfaces
# Extract plan data from doc and generate views
toggle = BooleanToggle(True)
layertable = LayerTable(Update=toggle, AutoUpdate=False)  # -> Layers, FullLayerPaths, LayerColors, Linetypes, MaterialNames, Visible, PrintWidth, PrintColor
panel_2 = Panel("""13
14
16
17
18
19
20""")
item = ListItem(List=layertable.LayerColors, Index=panel_2, Wrap=True)  # -> simplify(graft(Item))
item_2 = ListItem(List=layertable.Layers, Index=panel_2, Wrap=True)
panel_3 = Panel(item_2)
panel_4 = Panel(item)
list_2 = ValueList({"Point": 0, "Curve": 1, "Arc": 2, "Circle": 3, "Ellipse": 4, "Line": 5, "Polyline": 6, "Surface": 7, "Brep": 8, "Mesh": 9, "Polysurface": 10, "Block": 11, "Text": 12, "TextDot": 13, "Dimension": 14, "LinearDimension": 15, "AngularDimension": 16, "Hatch": 17, "Leader": 18}, selected="Curve")
reflay_2 = ReferenceByLayer(LayerName=item_2)  # -> simplify(Geometry)
filtertype_2 = FilterByType(Geometry=reflay_2, ObjectType=list_2)
boundary = BoundarySurfaces(Edges=filtertype_2)

# ---- group: Animate to generate images
index = Slider(79, range=0..103)

# ---- group: Set to True to enable image saving
toggle_2 = BooleanToggle(False)

# ---- group: Create string label from boundary number
lng = ListLength(List=crv)
series = Series(Start=0, Step=1, Count=lng)
txt = Text(series)
item_3 = ListItem(List=txt, Index=index, Wrap=True)

# ---- group: Corner points for each viewport area
item_4 = ListItem(List=crv, Index=index, Wrap=True)
bbox = BoundingBox(Content=item_4, Plane=PlaneXY(0, 0, 0))  # -> Box, Box_2
debrep = DeconstructBrep(Brep=bbox.Box)  # -> Faces, Edges, Vertices
item_5 = ListItem(List=debrep.Vertices, Index=0, Wrap=True)  # -> Item, Item1, Item2

# ---- group: Color Fill (B Images)
mesh = Mesh(boundary)
preview = CustomPreview(Geometry=mesh, Material=item)

# ---- group: Black Fill (A Images)
swatch = ColourSwatch(SwatchColor=RGB(0, 0, 0))
material = CreateMaterial(Diffuse=swatch, Specular=swatch, Emission=swatch, Transparency=0, Shine=0)
preview_2 = CustomPreview(Geometry=mesh, Material=graft(material))

# ---- group: Select folder for image output
path = FilePath("C:\Users\petersna\Desktop\Dataset Output\Set 2\Source Plans\")

# ----
c_script = CSharpScript(x=item_4, dir=path, GH_Box=bbox.Box, imgLabel=item_3, pointA=item_5.Item, pointB=item_5.Item2, run=toggle_2)  # -> out, A; inputs x: Polyline, dir: String, imgLabel: String, pointA: Point3d, pointB: Point3d, run: Boolean
# ---------- c_script: C# usings ----------
using System.IO;
using System.Linq;
using System.Data;
using System.Drawing;
using System.Reflection;
using System.Windows.Forms;
using System.Xml;
using System.Xml.Linq;
using System.Runtime.InteropServices;

using Rhino.DocObjects;
using Rhino.Collections;
using GH_IO;
using GH_IO.Serialization;
# ---------- c_script: C# ----------
    var view = doc.Views.ActiveView;
    var bbox = new Rhino.Geometry.BoundingBox(pointA, pointB);

    view.ActiveViewport.ZoomBoundingBox(bbox);
    view.Redraw();

    if (run == true) {
      // string file = "C:\\Users\\petersna\\Desktop\\Dataset Output\\Rhino Screenshot Outputs\\B\\" + imgLabel + ".png";
      string file = dir + imgLabel + ".png";
      var bitmap = doc.Views.ActiveView.CaptureToBitmap(false, false, false);

      // Crop and resize bitmap
      var newBmp = MakeSquarePhoto(bitmap, 256);
      newBmp.Save(file);
      A = newBmp;
    }
# ---------- c_script: C# additional code ----------
  private Bitmap MakeSquarePhoto(Bitmap bmp, int size)
  {
    try
    {
      Bitmap res = new Bitmap(size, size);
      Graphics g = Graphics.FromImage(res);
      g.FillRectangle(new SolidBrush(Color.White), 0, 0, size, size);

      var originalSquareSize = 674;
      g.DrawImage(bmp,
        new Rectangle(0, 0, size, size),
        new Rectangle(409, 33, originalSquareSize, originalSquareSize),
        GraphicsUnit.Pixel);

      Print("Width: " + bmp.Width.ToString());
      Print("Height: " + bmp.Height.ToString());
      return res;
    }
    catch {
      return null;
    }
  }
# ---------- end c_script ----------
